# Dynamo custom node BlockXLength.dyf (Dynamo 2.5.2.7915)
# category: SIP_Tools
# Returns the length of a block in the X direction

block = Input(block: Autodesk.AutoCAD.DynamoNodes.Block)
objects = Autodesk.AutoCAD.DynamoNodes.Block.Objects(block=block)
geometry = Autodesk.AutoCAD.DynamoNodes.Object.Geometry(object=objects)
byGeometry = BoundingBox.ByGeometry(geom=geometry)
maxPoint = BoundingBox.MaxPoint(boundingBox=byGeometry)
X = Point.X(point=maxPoint)
minPoint = BoundingBox.MinPoint(boundingBox=byGeometry)
X_2 = Point.X(point=minPoint)
sub = X - X_2
var = Output(sub)  # "var[]..[]"
