# Dynamo custom node PlaceBarrierBlocks.dyf (Dynamo 2.5.2.7915)
# category: SIP_Tools

current = Autodesk.AutoCAD.DynamoNodes.Document.Current()
blockName = Input(blockName: string)
blockByName = Autodesk.AutoCAD.DynamoNodes.Document.BlockByName(document=current, name=blockName)
blockReferencesToJoin = Input(blockReferencesToJoin: Autodesk.AutoCAD.DynamoNodes.BlockReference[]..[])

# group: Rotate coordinate system to move barriers from xy plane to xz plane
coordinateSystem = Autodesk.AutoCAD.DynamoNodes.BlockReference.CoordinateSystem(blockReference=blockReferencesToJoin)
YZPlane = CoordinateSystem.YZPlane(coordinateSystem=coordinateSystem)
code_block = CodeBlock { 90; }
rotate = CoordinateSystem.Rotate(coordinateSystem=coordinateSystem, plane=YZPlane, degrees=code_block)

# group: Barrier start coordinate systems
code_block_2 = CodeBlock { -1; }
removeItemAtIndex = List.RemoveItemAtIndex(list=rotate@@L2, indices=code_block_2)

# group: Start points
origin = CoordinateSystem.Origin(coordinateSystem=removeItemAtIndex)

# group: Barrier End Coordinate Systems
code_block_3 = CodeBlock { 0; }
removeItemAtIndex_2 = List.RemoveItemAtIndex(list=rotate@@L2, indices=code_block_3)

# group: Barrier End Points
origin_2 = CoordinateSystem.Origin(coordinateSystem=removeItemAtIndex_2)

byTwoPoints = Vector.ByTwoPoints(start=origin, end=origin_2)
YAxis = CoordinateSystem.YAxis(coordinateSystem=removeItemAtIndex)

# group: Get horizontally rotated coordinate system
X = Vector.X(vector=byTwoPoints)
Y = Vector.Y(vector=byTwoPoints)
byCoordinates = Vector.ByCoordinates(x=X, y=Y)
byOriginVectors = CoordinateSystem.ByOriginVectors(origin=origin, xAxis=byCoordinates, yAxis=YAxis)

drawLayer = Input(drawLayer: string)
modelSpace = Autodesk.AutoCAD.DynamoNodes.Document.ModelSpace(document=current)

# group: Place Barrier Blocks
byCoordinateSystem = Autodesk.AutoCAD.DynamoNodes.BlockReference.ByCoordinateSystem(sourceBlock=blockByName, coordinateSystem=byOriginVectors, layer=drawLayer, block=modelSpace)

# group: Find vertical rotations
XAxis = CoordinateSystem.XAxis(coordinateSystem=byOriginVectors)
ZAxis = CoordinateSystem.ZAxis(coordinateSystem=byOriginVectors)
vertical_rotation = Vector.AngleAboutAxis(vector=XAxis, otherVector=byTwoPoints, rotationAxis=ZAxis)

# group: Set Dynamic Block Parameters
code_block_4 = CodeBlock { "PostSpacing"; }
length = Vector.Length(vector=byTwoPoints)
setDynamicPropertyByName = Autodesk.AutoCAD.DynamoNodes.BlockReference.SetDynamicPropertyByName(blockReference=byCoordinateSystem, name=code_block_4, value=length)
code_block_5 = CodeBlock { "VerticalRotation"; }
degreesToRadians = Math.DegreesToRadians(degrees=vertical_rotation)
setDynamicPropertyByName_2 = Autodesk.AutoCAD.DynamoNodes.BlockReference.SetDynamicPropertyByName(blockReference=setDynamicPropertyByName, name=code_block_5, value=degreesToRadians)

BlockReference = Output(setDynamicPropertyByName_2)
