# Dynamo custom node FilterBlocksByName.dyf (Dynamo 2.5.2.7915)
# category: SIP_Tools
# Filters blocks based on given string. Outputs blocks and block names that containt the input string.

current = Autodesk.AutoCAD.DynamoNodes.Document.Current()
blocks = Autodesk.AutoCAD.DynamoNodes.Document.Blocks(document=current)
name = Autodesk.AutoCAD.DynamoNodes.Block.Name(block=blocks)
nameFilter = Input(nameFilter: string)
boolean = BoolSelector(true)
contains = String.Contains(str=name, searchFor=nameFilter, ignoreCase=boolean)
filterByBoolMask = List.FilterByBoolMask(list=name, mask=contains)
filterByBoolMask_2 = List.FilterByBoolMask(list=blocks, mask=contains)
code_block = CodeBlock(BlockNames=filterByBoolMask.in, Blocks=filterByBoolMask_2.in) { BlockNames; Blocks; }
BlockNames = Output(code_block.BlockNames)  # "BlockNames[]"
Blocks = Output(code_block.Blocks)  # "Blocks[]"
