# Dynamo custom node PlaceBlocksAlongAlignment.dyf (Dynamo 2.5.2.7915)
# category: SIP_Tools

current = Autodesk.AutoCAD.DynamoNodes.Document.Current()
blockName = Input(blockName: string)
blockByName = Autodesk.AutoCAD.DynamoNodes.Document.BlockByName(document=current, name=blockName)
alignment = Input(alignment: Autodesk.Civil.DynamoNodes.Alignment[]..[])
station = Input(station: double[]..[])
coordinateSystemByStationOffset = Autodesk.Civil.DynamoNodes.Alignment.CoordinateSystemByStationOffset(alignment=alignment, station=station)
origin = CoordinateSystem.Origin(coordinateSystem=coordinateSystemByStationOffset)
ZAxis = CoordinateSystem.ZAxis(coordinateSystem=coordinateSystemByStationOffset)
XAxis = Vector.XAxis()
YAxis = CoordinateSystem.YAxis(coordinateSystem=coordinateSystemByStationOffset)
ZAxis_2 = Vector.ZAxis()
angleAboutAxis = Vector.AngleAboutAxis(vector=XAxis, otherVector=YAxis, rotationAxis=ZAxis_2)
blockRotationAngle = Input(blockRotationAngle: double[]..[])
code_block = CodeBlock(a=angleAboutAxis, blockRotationAngle=blockRotationAngle) { a + [blockRotationAngle]; }
layer = Input(layer: string)
modelSpace = Autodesk.AutoCAD.DynamoNodes.Document.ModelSpace(document=current)
create = Autodesk.AutoCAD.DynamoNodes.BlockReference.Create(sourceBlock=blockByName, position=origin, normal=ZAxis, rotationDegrees=code_block, layer=layer, block=modelSpace)
BlockReference = Output(create)
block = Autodesk.AutoCAD.DynamoNodes.BlockReference.Block(blockReference=create)
objects = Autodesk.AutoCAD.DynamoNodes.Block.Objects(block=block)
Object = Output(objects)  # "Object[]"
