# Dynamo custom node PlaceBlocksAlongCorridorFeatureLine.dyf (Dynamo 2.5.2.7915)
# category: SIP_Tools
# Places specified blocks along corridor feature lines at given station locations

current = Autodesk.AutoCAD.DynamoNodes.Document.Current()
blockName = Input(blockName: string)
blockByName = Autodesk.AutoCAD.DynamoNodes.Document.BlockByName(document=current, name=blockName)
corridorFeatureLine = Input(corridorFeatureLine: Autodesk.Civil.DynamoNodes.CorridorFeatureLine[]..[])
station = Input(station: double[]..[])
coordinateSystemByStation = Autodesk.Civil.DynamoNodes.CorridorFeatureLine.CoordinateSystemByStation(corridorFeatureLine=corridorFeatureLine, station=station)
origin = CoordinateSystem.Origin(coordinateSystem=coordinateSystemByStation)
ZAxis = CoordinateSystem.ZAxis(coordinateSystem=coordinateSystemByStation)
XAxis = Vector.XAxis()
YAxis = CoordinateSystem.YAxis(coordinateSystem=coordinateSystemByStation)
ZAxis_2 = Vector.ZAxis()
angleAboutAxis = Vector.AngleAboutAxis(vector=XAxis, otherVector=YAxis, rotationAxis=ZAxis_2)
blockRotationAngle = Input(blockRotationAngle: double[]..[])
code_block = CodeBlock(a=angleAboutAxis, blockRotationAngle=blockRotationAngle) { a + [blockRotationAngle]; }
layer = Input(layer: string)
modelSpace = Autodesk.AutoCAD.DynamoNodes.Document.ModelSpace(document=current)
create = Autodesk.AutoCAD.DynamoNodes.BlockReference.Create(sourceBlock=blockByName, position=origin, normal=ZAxis, rotationDegrees=code_block, layer=layer, block=modelSpace)
BlockReference = Output(create)
block = Autodesk.AutoCAD.DynamoNodes.BlockReference.Block(blockReference=create)
objects = Autodesk.AutoCAD.DynamoNodes.Block.Objects(block=block)
Origins = Output(origin)
