# Dynamo custom node PlaceBlocksAlongPolycurve.dyf (Dynamo 2.5.2.7915)
# category: SIP_Tools

current = Autodesk.AutoCAD.DynamoNodes.Document.Current()
blockName = Input(blockName: string)
blockByName = Autodesk.AutoCAD.DynamoNodes.Document.BlockByName(document=current, name=blockName)
polycurve = Input(polycurve: Autodesk.DesignScript.Geometry.Curve[]..[])
station = Input(station: double[]..[])
length = Curve.Length(curve=polycurve)
div = station / length
pointAtParameter = Curve.PointAtParameter(curve=polycurve, param=div)
ZAxis = Vector.ZAxis()
XAxis = Vector.XAxis()
ZAxis_2 = Vector.ZAxis()
normalAtParameter = Curve.NormalAtParameter(curve=polycurve, param=div)
cross = Vector.Cross(vector=ZAxis_2, cross=normalAtParameter)
cross_2 = Vector.Cross(vector=ZAxis_2, cross=cross)
ZAxis_3 = Vector.ZAxis()
angleAboutAxis = Vector.AngleAboutAxis(vector=XAxis, otherVector=cross_2, rotationAxis=ZAxis_3)
# note: Angle corrction for consisency with corridor setout custom node
angle_correction = DoubleInput(-90)
blockRotationAngle = Input(blockRotationAngle: double[]..[])
code_block = CodeBlock(a=angleAboutAxis, angle_correction=angle_correction, blockRotationAngle=blockRotationAngle) { a + angle_correction + [blockRotationAngle]; }
layer = Input(layer: string)
modelSpace = Autodesk.AutoCAD.DynamoNodes.Document.ModelSpace(document=current)
create = Autodesk.AutoCAD.DynamoNodes.BlockReference.Create(sourceBlock=blockByName, position=pointAtParameter, normal=ZAxis, rotationDegrees=code_block, layer=layer, block=modelSpace)
BlockReference = Output(create)
block = Autodesk.AutoCAD.DynamoNodes.BlockReference.Block(blockReference=create)
objects = Autodesk.AutoCAD.DynamoNodes.Block.Objects(block=block)
Origins = Output(pointAtParameter)
