# Dynamo custom node UsageMetrics.dyf (Dynamo 2.5.2.7915)
# category: SIP_Tools
# Tracks run information an uploads to Power BI Database

scriptName = Input(scriptName: string)
scriptVersion = Input(scriptVersion: string)
usage_metrics = Python(IN[0]=scriptName, IN[1]=scriptVersion)
# ---------- usage_metrics.python (56 lines) ----------
# Load the Python Standard and DesignScript Libraries
import sys
import clr
import os
import os
from urllib2 import urlopen, Request
from urllib import urlencode, quote
import json
from System import Environment
from datetime import datetime


out_data = {}


clr.AddReference('AcDynamo')
from Autodesk.AutoCAD.DynamoApp import *
# Gets Dynamo instance so the active script can be recorded

def GetGraphNameCivil3D():
	AcDynamoRuntime.Initialize()
	DynamoModel = AcDynamoRuntime.DynamoModel
	DynamoWorkspace = DynamoModel.CurrentWorkspace
	return DynamoWorkspace.FileName



out_data['script_name'] = IN[0]
out_data['script_version'] = IN[1]

out_data['script_path'] = GetGraphNameCivil3D()

out_data['user_name'] = Environment.UserName

response = urlopen("http://www.ipinfo.io")
raw_data = response.read()

json_data = json.loads(raw_data.decode('utf8'))
out_data['location'] = json_data['city']

out_data['date_time'] = datetime.strftime(datetime.now(), "%Y-%m-%dT%H:%M:%SZ")

# Serializing json  
json_object = json.dumps(out_data)

push_url = "https://api.powerbi.com/beta/3d234255-e20f-4205-88a5-9658a402999b/datasets/ce46d815-e3b1-49fb-a0cb-d48e67628e51/rows?key=gaxNxC06d1SgcvVy4NxaAHoaHUTKSDOA84ww5kJTkDmX9VpAq9xAfivvYKfVbSeAoYUiSULTAHGwCRr3Jez%2BNA%3D%3D"

data = "["+json_object+"]"

request = Request(push_url, data)

#API Post
push_response = urlopen(request)

# Assign your output to the OUT variable.
OUT = [out_data]
# ----------------------------------------
OUT = Output(usage_metrics)
