# Dynamo graph Feature Line Barrier Setout - SW.dyn (Dynamo 2.5.2.7915)
# packages: Civil3DToolkit 1.1.19, Data-Shapes 2021.2.94

# group: Usage metric collection
code_block = CodeBlock { "Feature Line Barrier Setout"; "0.1.0"; }
usageMetrics = Custom[UsageMetrics](scriptName=code_block.out0, scriptVersion=code_block.out1)  # Tracks run information an uploads to Power BI Database

# group: Get Corridor Feature Lines
corridor_name = CorridorNameDropDown("Pokeno Road 4Lane")
corridor_barrier_code = StringInput("Barrier")
corridorFeatureLinesByCode = Custom[CorridorFeatureLinesByCode](corridor=corridor_name, code=corridor_barrier_code)  # frozen; Returns all corridor feature lines for a given code

polyCurve = Autodesk.Civil.DynamoNodes.CorridorFeatureLine.PolyCurve(corridorFeatureLine=corridorFeatureLinesByCode.CorridorFeatureLine)
post_spacing = DoubleSlider(2, range=0..500 step 1)
start_terminal_offset = DoubleSlider(15.5, range=0..500 step 1)
end_terminal_offset = DoubleSlider(15.5, range=0..500 step 1)

# group: Get existing feature lines
objects_types = AcObjectTypes("FeatureLine")
current = Autodesk.AutoCAD.DynamoNodes.Document.Current()
modelSpace = Autodesk.AutoCAD.DynamoNodes.Document.ModelSpace(document=current)
all_objects_of_type = AcObjectsOfType(type=objects_types, block=modelSpace)
name = Autodesk.Civil.DynamoNodes.CivilObject.Name(civilObject=all_objects_of_type)
code_block_2 = CodeBlock { ""; }
eq = name == code_block_2
filterByBoolMask = List.FilterByBoolMask(list=all_objects_of_type, mask=eq)
filterByBoolMask_2 = List.FilterByBoolMask(list=name, mask=eq)
code_block_3 = CodeBlock(feature_lines=filterByBoolMask.out, feature_line_names=filterByBoolMask_2.out) { feature_lines; feature_line_names; }
watch = Watch(code_block_3.feature_line_names)
watch_2 = Watch(code_block_3.feature_lines)

# group: User Interface
string = StringInput("Select feature line for creation of barrier")
code_block_4 = CodeBlock { "Next"; "Cancel"; "DOC_LINK"; 450; 200; "./Logo.png"; }
string_2 = StringInput("Feature Line")
code_block_5 = CodeBlock { 0; }
dropdown_data = Custom[DropDown Data](InputName=string_2, Keys=watch, Values=watch_2, DefaultValueIndex=code_block_5)  # package Data-Shapes; Create data for DropDown input in UI.MultiInputForm ++ . Check out www.data-shapes.net for more infos.
list_create = List.Create(item0=dropdown_data)
boolean = BoolSelector(true)
multipleinputform = Custom[MultipleInputForm ++](Description_optional=string, Logo_optional=code_block_4.out5, ButtonText_optional=code_block_4.out0, Inputs=list_create, Toggle=boolean, LinkToHelp_optional=code_block_4.out2, CancelButtonText_optional=code_block_4.out1, Width_optional=code_block_4.out3, LabelWidth_optional=code_block_4.out4)  # package Data-Shapes; Create a form with multiple inputs. see www.data-shapes.net for tutorials and infos!
code_block_6 = CodeBlock(result=multipleinputform.User_Inputs) { featureLine = result[0]; }
string_3 = StringInput("Set barrier parameters")
code_block_7 = CodeBlock { "Create Barrier"; "Cancel"; "DOC_LINK"; 450; 200; "./Logo.png"; }
code_block_8 = CodeBlock { "Post Spacing"; "2.000"; }
boolean_2 = BoolSelector(true)
textbox_data = Custom[TextBox Data](InputName=code_block_8.out0, DefaultText=code_block_8.out1, IsNumberEntry=boolean_2)  # package Data-Shapes; Create Data for TextBox input in UI.MultipleInputForm ++ . Check out www.data-shapes.net for more informations
code_block_9 = CodeBlock { "Start Offset"; "0.000"; }
boolean_3 = BoolSelector(true)
textbox_data_2 = Custom[TextBox Data](InputName=code_block_9.out0, DefaultText=code_block_9.out1, IsNumberEntry=boolean_3)
code_block_10 = CodeBlock { "End Offset"; "0.000"; }
boolean_4 = BoolSelector(true)
textbox_data_3 = Custom[TextBox Data](InputName=code_block_10.out0, DefaultText=code_block_10.out1, IsNumberEntry=boolean_4)
code_block_11 = CodeBlock { "Equalise Start and End Spacings"; ""; }
boolean_5 = BoolSelector(true)
boolean_input = Custom[Boolean input](InputName=code_block_11.out0, DefaultValue=boolean_5, SideText=code_block_11.out1)  # package Data-Shapes; Creates a boolean input for UI.MultipleInputForm ++ . Check out www.data-shapes.net for more infos!
code_block_12 = CodeBlock { "Start Rotation"; "0.000"; }
boolean_6 = BoolSelector(true)
textbox_data_4 = Custom[TextBox Data](InputName=code_block_12.out0, DefaultText=code_block_12.out1, IsNumberEntry=boolean_6)
code_block_13 = CodeBlock { "End Rotation"; "0.000"; }
boolean_7 = BoolSelector(true)
textbox_data_5 = Custom[TextBox Data](InputName=code_block_13.out0, DefaultText=code_block_13.out1, IsNumberEntry=boolean_7)
code_block_14 = CodeBlock { "Output Layer"; "BARRIER"; }
boolean_8 = BoolSelector(false)
textbox_data_6 = Custom[TextBox Data](InputName=code_block_14.out0, DefaultText=code_block_14.out1, IsNumberEntry=boolean_8)
list_create_2 = List.Create(item0=textbox_data, item1=textbox_data_2, item2=textbox_data_3, item3=boolean_input, item4=textbox_data_4, item5=textbox_data_5, item6=textbox_data_6)
string_4 = StringInput("Select barrier blocks")
code_block_15 = CodeBlock { "Next"; "Cancel"; "DOC_LINK"; 450; 200; "./Logo.png"; }
string_5 = StringInput("Barrier Block")
string_6 = StringInput("Barr")
filterBlocksByName = Custom[FilterBlocksByName](nameFilter=string_6)  # Filters blocks based on given string. Outputs blocks and block names that containt the input string.
code_block_16 = CodeBlock { 0; }
dropdown_data_2 = Custom[DropDown Data](InputName=string_5, Keys=filterBlocksByName.BlockNames, Values=filterBlocksByName.Blocks, DefaultValueIndex=code_block_16)
string_7 = StringInput("Post Block")
string_8 = StringInput("Post")
filterBlocksByName_2 = Custom[FilterBlocksByName](nameFilter=string_8)
code_block_17 = CodeBlock { 0; }
dropdown_data_3 = Custom[DropDown Data](InputName=string_7, Keys=filterBlocksByName_2.BlockNames, Values=filterBlocksByName_2.Blocks, DefaultValueIndex=code_block_17)
string_9 = StringInput("Start Terminal/Transition Block")
string_10 = StringInput("Terminal")
filterBlocksByName_3 = Custom[FilterBlocksByName](nameFilter=string_10)
code_block_18 = CodeBlock { 0; }
dropdown_data_4 = Custom[DropDown Data](InputName=string_9, Keys=filterBlocksByName_3.BlockNames, Values=filterBlocksByName_3.Blocks, DefaultValueIndex=code_block_18)
# note: TODO: Add none option to terminal selection
string_11 = StringInput("EndTerminal/Transition Block")
code_block_19 = CodeBlock { 0; }
dropdown_data_5 = Custom[DropDown Data](InputName=string_11, Keys=filterBlocksByName_3.BlockNames, Values=filterBlocksByName_3.Blocks, DefaultValueIndex=code_block_19)
list_create_3 = List.Create(item0=dropdown_data_2, item1=dropdown_data_3, item2=dropdown_data_4, item3=dropdown_data_5)
boolean_9 = BoolSelector(true)
not_ = Not(x=multipleinputform.Was_Cancelled)
and_ = And(bool0=multipleinputform.Was_Run, bool1=boolean_9, bool2=not_)
multipleinputform_2 = Custom[MultipleInputForm ++](Description_optional=string_4, Logo_optional=code_block_15.out5, ButtonText_optional=code_block_15.out0, Inputs=list_create_3, Toggle=and_, LinkToHelp_optional=code_block_15.out2, CancelButtonText_optional=code_block_15.out1, Width_optional=code_block_15.out3, LabelWidth_optional=code_block_15.out4)
boolean_10 = BoolSelector(true)
not_2 = Not(x=multipleinputform_2.Was_Cancelled)
and_2 = And(bool0=multipleinputform_2.Was_Run, bool1=boolean_10, bool2=not_2)
multipleinputform_3 = Custom[MultipleInputForm ++](Description_optional=string_3, Logo_optional=code_block_7.out5, ButtonText_optional=code_block_7.out0, Inputs=list_create_2, Toggle=and_2, LinkToHelp_optional=code_block_7.out2, CancelButtonText_optional=code_block_7.out1, Width_optional=code_block_7.out3, LabelWidth_optional=code_block_7.out4)
code_block_20 = CodeBlock(result=multipleinputform_3.User_Inputs)
# ---------- code_block_20.designscript (7 lines) ----------
postSpacing = result[0];
startOffset = result[1];
endOffset = result[2];
equaliseSpacings = result[3];
startRotation = result[4];
endRotation = result[5];
outputLayer = result[6];
# ----------------------------------------
code_block_21 = CodeBlock(result=multipleinputform_2.User_Inputs) { barrierBlock = result[0]; postBlock = result[1]; startTerminalBlock = result[2]; endTerminalBlock = result[3]; }

code_block_22 = CodeBlock(featureLine=code_block_6) { FeatureLine.GetRefinedPolyCurve(featureLine); }
code_block_23 = CodeBlock(polyCurve=code_block_22) { polyCurve; }
list_create_4 = List.Create(item0=code_block_23)
code_block_24 = CodeBlock(postSpacing=code_block_20.postSpacing, startTerminalOffset=code_block_20.startOffset, endTerminalOffset=code_block_20.endOffset) { postSpacing; startTerminalOffset; endTerminalOffset; }

# group: Add terminal lengths to offsets
blockXLength = Custom[BlockXLength](block=code_block_21.startTerminalBlock)  # Returns the length of a block in the X direction
add = code_block_24.startTerminalOffset + blockXLength
blockXLength_2 = Custom[BlockXLength](block=code_block_21.endTerminalBlock)
add_2 = code_block_24.endTerminalOffset + blockXLength_2

code_block_25 = CodeBlock(layer=code_block_20.outputLayer) { layer; }

# group: Polyline set out start terminal
post_block_name = StringInput("TL3_Terminal")
name_2 = Autodesk.AutoCAD.DynamoNodes.Block.Name(block=code_block_21.startTerminalBlock)
post_rotation_angle = DoubleInput(0)
add_3 = post_rotation_angle + code_block_20.startRotation
placeBlocksAlongPolycurve = Custom[PlaceBlocksAlongPolycurve](polycurve=list_create_4, station=add, blockName=name_2, blockRotationAngle=add_3, layer=code_block_25)

# group: Calculate end point
length = Curve.Length(curve=list_create_4)
sub = length - add_2

# group: Polyline set out end terminal
post_block_name_2 = StringInput("TL3_Terminal")
name_3 = Autodesk.AutoCAD.DynamoNodes.Block.Name(block=code_block_21.endTerminalBlock)
post_rotation_angle_2 = DoubleInput(180)
add_4 = post_rotation_angle_2 + code_block_20.endRotation
placeBlocksAlongPolycurve_2 = Custom[PlaceBlocksAlongPolycurve](polycurve=list_create_4, station=sub, blockName=name_3, blockRotationAngle=add_4, layer=code_block_25)

# group: Calculate offset to equalise start and end spacings
sub_2 = sub - add
mod = sub_2 % code_block_24.postSpacing

# group: Polyline set out posts
post_block_name_3 = StringInput("TL3_Post")
range = Range(start=add, end=sub, step=code_block_24.postSpacing)
offset_points = CodeBlock(a=range, b=mod) { a; b; c=a+b/2; }
if_ = If(test=code_block_20.equaliseSpacings, true=offset_points.c, false=range)
name_4 = Autodesk.AutoCAD.DynamoNodes.Block.Name(block=code_block_21.postBlock)
post_rotation_angle_3 = DoubleInput(0)
placeBlocksAlongPolycurve_3 = Custom[PlaceBlocksAlongPolycurve](polycurve=list_create_4, station=if_, blockName=name_4, blockRotationAngle=post_rotation_angle_3, layer=code_block_25)

# group: Get lists of terminal and post objects
join = List.Join()  # unwired: list0, list1, list2
code_block_26 = CodeBlock(start_terminal=placeBlocksAlongPolycurve.BlockReference) { start_terminal; }
code_block_27 = CodeBlock { 2; }
flatten = List.Flatten(list=code_block_26, amt=code_block_27)
code_block_28 = CodeBlock { 1; }
chop = List.Chop(list=flatten, lengths=code_block_28)
code_block_29 = CodeBlock(posts=placeBlocksAlongPolycurve_3.BlockReference) { posts; }
code_block_30 = CodeBlock(end_terminal=placeBlocksAlongPolycurve_2.BlockReference) { end_terminal; }
code_block_31 = CodeBlock { 2; }
flatten_2 = List.Flatten(list=code_block_30, amt=code_block_31)
code_block_32 = CodeBlock { 1; }
chop_2 = List.Chop(list=flatten_2, lengths=code_block_32)
combine = List.Combine(comb=join, list1=chop, list2=code_block_29, list3=chop_2)
flatten_3 = List.Flatten(list=code_block_29)

# group: Place Barrier Elements
post_block_name_4 = StringInput("Wire_Rope_Barrier")
name_5 = Autodesk.AutoCAD.DynamoNodes.Block.Name(block=code_block_21.barrierBlock)
placeBarrierBlocks = Custom[PlaceBarrierBlocks](blockReferencesToJoin=combine, blockName=name_5, drawLayer=code_block_25)

addNewTypes = Autodesk.AutoCAD.DynamoNodes.DocumentExtensions.AddNewTypes()
string_12 = StringInput("Barrier")
watch_3 = Watch(flatten_3)
watch_4 = Watch(chop_2)
watch_5 = Watch(chop)
watch_6 = Watch(code_block_26)
watch_7 = Watch(code_block_29)
watch_8 = Watch(code_block_30)
watch_9 = Watch(combine)
