# Dynamo graph User Interface Test.dyn (Dynamo 2.5.2.7915)
# packages: Data-Shapes 2021.2.94, Civil3DToolkit 1.1.19

code_block = CodeBlock { "Create Barrier from Feature Line"; }
file_path = Filename(".\logo.png")
code_block_2 = CodeBlock { "Create Barrier"; }
string = StringInput("Barrier Point Code")
string_2 = StringInput("Barrier")
boolean = BoolSelector(false)
textbox_data = Custom[TextBox Data](InputName=string, DefaultText=string_2, IsNumberEntry=boolean)  # package Data-Shapes; Create Data for TextBox input in UI.MultipleInputForm ++ . Check out www.data-shapes.net for more informations
code_block_3 = CodeBlock { "Feature Line"; }
current = Autodesk.AutoCAD.DynamoNodes.Document.Current()
getSites = Autodesk.Civil.DynamoNodes.LandDevelopment.Site.GetSites(document=current)
getFeatureLines = Autodesk.Civil.DynamoNodes.LandDevelopment.Site.GetFeatureLines(site=getSites)
name = Autodesk.Civil.DynamoNodes.CivilObject.Name(civilObject=getFeatureLines)
flatten = List.Flatten(list=name)
length = String.Length(str=flatten)
code_block_4 = CodeBlock { 0; }
eq = Equals(x=length, y=code_block_4)
filterByBoolMask = List.FilterByBoolMask(list=flatten, mask=eq)
flatten_2 = List.Flatten(list=getFeatureLines)
filterByBoolMask_2 = List.FilterByBoolMask(list=flatten_2, mask=eq)
dropdown_data = Custom[DropDown Data](InputName=code_block_3, Keys=filterByBoolMask.out, Values=filterByBoolMask_2.out)  # package Data-Shapes; Create data for DropDown input in UI.MultiInputForm ++ . Check out www.data-shapes.net for more infos.
code_block_5 = CodeBlock { "Start Terminal Block"; }
blocks = Autodesk.AutoCAD.DynamoNodes.Document.Blocks(document=current)
name_2 = Autodesk.AutoCAD.DynamoNodes.Block.Name(block=blocks)

# group: Terminal Block Mask
code_block_6 = CodeBlock { "Term"; }
boolean_2 = BoolSelector(true)
contains = String.Contains(str=name_2, searchFor=code_block_6, ignoreCase=boolean_2)
block_name_mask = List.FilterByBoolMask(list=name_2, mask=contains)
block_mask = List.FilterByBoolMask(list=blocks, mask=contains)

dropdown_data_2 = Custom[DropDown Data](InputName=code_block_5, Keys=block_name_mask.in, Values=block_mask.in)
code_block_7 = CodeBlock { "End Terminal Block"; }
dropdown_data_3 = Custom[DropDown Data](InputName=code_block_7, Keys=block_name_mask.in, Values=block_mask.in)
code_block_8 = CodeBlock { "Post Block"; }

# group: Post Block Mask
code_block_9 = CodeBlock { "Post"; }
boolean_3 = BoolSelector(true)
contains_2 = String.Contains(str=name_2, searchFor=code_block_9, ignoreCase=boolean_3)
block_name_mask_2 = List.FilterByBoolMask(list=name_2, mask=contains_2)
block_mask_2 = List.FilterByBoolMask(list=blocks, mask=contains_2)

dropdown_data_4 = Custom[DropDown Data](InputName=code_block_8, Keys=block_name_mask_2.in, Values=block_mask_2.in)
string_3 = StringInput("Post Spacing")
string_4 = StringInput("2.000")
boolean_4 = BoolSelector(true)
textbox_data_2 = Custom[TextBox Data](InputName=string_3, DefaultText=string_4, IsNumberEntry=boolean_4)
list_create = List.Create(item0=textbox_data, item1=dropdown_data, item2=dropdown_data_2, item3=dropdown_data_3, item4=dropdown_data_4, item5=textbox_data_2)
boolean_5 = BoolSelector(false)
code_block_10 = CodeBlock { "Cancel"; }
multipleinputform = Custom[MultipleInputForm ++](Description_optional=code_block, Logo_optional=file_path, ButtonText_optional=code_block_2, Inputs=list_create, Toggle=boolean_5, CancelButtonText_optional=code_block_10)  # package Data-Shapes; Create a form with multiple inputs. see www.data-shapes.net for tutorials and infos!
code_block_11 = CodeBlock(lst=multipleinputform.User_Inputs)
# ---------- code_block_11.designscript (6 lines) ----------
CorridorPointCode = lst[0];
FeatLine = lst[1];
StartTerminalBlock = lst[2];
End_TerminalBlock = lst[3];
PostBlock = lst[4];
PostSpacing = lst[5];
# ----------------------------------------
watch = Watch(filterByBoolMask.out)
watch_2 = Watch(filterByBoolMask_2.out)
string_5 = StringInput("Corridor")
current_2 = Autodesk.AutoCAD.DynamoNodes.Document.Current()
corridors = Corridors(document=current_2)
name_3 = Autodesk.Civil.DynamoNodes.CivilObject.Name(civilObject=corridors)
dropdown_data_5 = Custom[DropDown Data](InputName=string_5, Keys=name_3, Values=corridors)
list_create_2 = List.Create(item0=dropdown_data_5)
boolean_6 = BoolSelector(true)
multipleinputform_2 = Custom[MultipleInputForm ++](Inputs=list_create_2, Toggle=boolean_6)
code_block_12 = CodeBlock(lst=multipleinputform_2.User_Inputs) { corridors=lst[0]; }
codes = Autodesk.Civil.DynamoNodes.Corridor.Codes(corridor=code_block_12)
watch_3 = Watch(codes.Point_Codes)
watch_4 = Watch(list_create_2)
watch_5 = Watch(codes.Point_Codes)
watch_6 = Watch(code_block_12)
string_6 = StringInput("Point Code")
dropdown_data_6 = Custom[DropDown Data](InputName=string_6, Keys=codes.Point_Codes, Values=codes.Point_Codes)
multipleinputform_3 = Custom[MultipleInputForm ++](Inputs=dropdown_data_6, Toggle=multipleinputform_2.Was_Run)
code_block_13 = CodeBlock { [0,0,0]; }
if_ = If(test=multipleinputform_3.Was_Run, true=multipleinputform_3.User_Inputs, false=code_block_13)
code_block_14 = CodeBlock(lst=if_) { code=lst[0]; }
corridorFeatureLinesByCode = Custom[CorridorFeatureLinesByCode](corridor=code_block_12, code=code_block_14)  # Returns all corridor feature lines for a given code
watch_7 = Watch(corridorFeatureLinesByCode.CorridorFeatureLine)
code_block_15 = CodeBlock { "Corridor"; }
byName = Autodesk.Civil.DynamoNodes.CorridorExtensions.CorridorExtensions.ByName(name=code_block_15)
code_block_16 = CodeBlock { "Back_Curb"; }
corridorFeatureLinesByCode_2 = Custom[CorridorFeatureLinesByCode](corridor=byName, code=code_block_16)
watch_8 = Watch(corridorFeatureLinesByCode_2.TkCorridorFeatureLine)
side = Autodesk.Civil.DynamoNodes.CorridorExtensions.TkCorridorFeatureLine.Side(tkCorridorFeatureLine=corridorFeatureLinesByCode_2.TkCorridorFeatureLine)
code = Autodesk.Civil.DynamoNodes.CorridorExtensions.TkCorridorFeatureLine.Code(tkCorridorFeatureLine=corridorFeatureLinesByCode_2.TkCorridorFeatureLine)
code_block_17 = CodeBlock { "Corridor Feature Line"; }
side_2 = Autodesk.Civil.DynamoNodes.CorridorExtensions.TkCorridorFeatureLine.Side(tkCorridorFeatureLine=corridorFeatureLinesByCode_2.TkCorridorFeatureLine)
flatten_3 = List.Flatten(list=side_2)
code_block_18 = CodeBlock(x=flatten_3) { x==1; }
code_block_19 = CodeBlock { "Right"; "Left"; }
if_2 = If(test=code_block_18, true=code_block_19.out0, false=code_block_19.out1)
dropdown_data_7 = Custom[DropDown Data](InputName=code_block_17, Keys=if_2, Values=corridorFeatureLinesByCode.CorridorFeatureLine)
multipleinputform_4 = Custom[MultipleInputForm ++](Inputs=dropdown_data_7, Toggle=multipleinputform_3.Was_Run)
listview_data = Custom[Listview Data]()  # package Data-Shapes; Create data for ListView input in UI.MultiInputForm ++ . Check out www.data-shapes.net for more infos.; unwired: Keys, Values
